# Dynamo graph Заполнение BI_этаж по нижней границе.dyn (Dynamo 2.0.4.12684)

категории = Python()  # graph input
# ---------- категории.python (61 lines) ----------
OUT = ["Арматура воздуховодов",
	"Арматура трубопроводов",
	"Воздуховоды",
	"Воздухораспределители",
	"Гибкие воздуховоды",
	"Гибкие трубы",
	"Датчики",
	"Двери",
	"Импосты витража",
	"Кабельные лотки",
	"Каркас несущий",
	"Колонны",
	"Комплекты мебели",
	"Короба",
	"Крыши",
	"Лестницы",
	"Лестницы - Марши",
	"Лестницы - Площадки",
	"Лестницы - Опоры",
	"Материалы изоляции воздуховодов",
	"Материалы изоляции труб",
	"Мебель",
	"Наборы оборудования",
	"Несущая арматура",
	"Несущие колонны",
	"Обобщенные модели",
	"Оборудование",
	"Ограждение",
	"Ограждение - Верхние поручни",
	"Ограждение - Опоры",
	"Ограждение - Перила",
	"Окна",
	"Осветительные приборы",
	"Охранная сигнализация",
	"Пандус",
	"Панели витража",
	"Парковка",
	"Перекрытия",
	"Пожарная сигнализация",
	"Помещения",
	"Потолки",
	"Провода",
	"Сантехнические приборы",
	"Соединения несущих конструкций",
	"Соединители несущей арматуры",
	"Соединительные детали воздуховодов",
	"Соединительные детали кабельных лотков",
	"Соединительные детали коробов",
	"Соединительные детали трубопроводов",
	"Специальное оборудование",
	"Спринклеры",
	"Стены",
	"Стены - Выступающие профили",
	"Телефонные устройства",
	"Трубы",
	"Устройства вызова и оповещения",
	"Устройства связи",
	"Фундамент несущей конструкции",
	"Шкафы",
	"Электрические приборы",
	"Электрооборудование"]
# ----------------------------------------
byName = Category.ByName(name=категории)
all_elements_of_category = ElementsOfCategory(Category=byName)
flatten = List.Flatten(list=all_elements_of_category)
parameters = Element.Parameters(element=flatten)
name = Parameter.Name(parameter=parameters)
заполняемый_параметр = StringInput("BI_этаж")
# note: Фильтрация по наличию параметра этажа
contains = List.Contains(list=name@L2, item=заполняемый_параметр)
filterByBoolMask = List.FilterByBoolMask(list=flatten, mask=contains)
parameterByName = Parameter.ParameterByName(element=filterByBoolMask.in, name=заполняемый_параметр)
# note: Исключение элементов с нередактируемым параметром этажа
isReadOnly = Parameter.IsReadOnly(parameter=parameterByName)
filterByBoolMask_2 = List.FilterByBoolMask(list=filterByBoolMask.in, mask=isReadOnly)
boundingBox = Element.BoundingBox(element=filterByBoolMask_2.out)
isNull = Object.IsNull(obj=boundingBox)
filterByBoolMask_3 = List.FilterByBoolMask(list=filterByBoolMask_2.out, mask=isNull)
filterByBoolMask_4 = List.FilterByBoolMask(list=boundingBox, mask=isNull)
minPoint = BoundingBox.MinPoint(boundingBox=filterByBoolMask_4.out)
# note: Получение нижних координат
Z = Point.Z(point=minPoint)
basePoint = Coordinates.BasePoint()
Z_2 = Point.Z(point=basePoint)
sub = Z - Z_2
смещение_уровня_от_пола = IntegerSlider(100, range=0..300 step 50)  # graph input
code_block = CodeBlock(a=sub, delta=смещение_уровня_от_пола)
# ---------- code_block.designscript (2 lines) ----------
//имеет дополнительное смещение
Math.Ceiling(a/5)*5+250+delta;
# ----------------------------------------
code_block_2 = CodeBlock { "Уровни"; }
byName_2 = Category.ByName(name=code_block_2)
all_elements_of_category_2 = ElementsOfCategory(Category=byName_2)
name_2 = Level.Name(level=all_elements_of_category_2)
code_block_3 = CodeBlock { " "; 0; }
split = String.Split(str=name_2, separater0=code_block_3.out0)
# note: Получение номеров и отметок этажей
getItemAtIndex = List.GetItemAtIndex(list=split@L2, index=code_block_3.out1)
is_contains_digit_pyscript = Python(IN[0]=getItemAtIndex)
# ---------- is_contains_digit_pyscript.python (5 lines) ----------
import re

inputStrings = IN[0]

OUT = [bool(re.search(r'\d', string)) for string in inputStrings]
# ----------------------------------------
filterByBoolMask_5 = List.FilterByBoolMask(list=getItemAtIndex, mask=is_contains_digit_pyscript)
toNumber = String.ToNumber(str=filterByBoolMask_5.in)
filterByBoolMask_6 = List.FilterByBoolMask(list=all_elements_of_category_2, mask=is_contains_digit_pyscript)
projectElevation = Level.ProjectElevation(level=filterByBoolMask_6.in)
sortByKey = List.SortByKey(list=toNumber, keys=projectElevation)
reverse = List.Reverse(list=sortByKey.sorted_list)
reverse_2 = List.Reverse(list=sortByKey.sorted_keys)
основной_код = Python(IN[0]=code_block, IN[1]=reverse, IN[2]=reverse_2)
# ---------- основной_код.python (20 lines) ----------
elementElevations = IN[0]

lvlNumList = IN[1]
lvlElevList = IN[2]

output = []

for value in elementElevations:

    if value < 0:
        output.append(-1)
        continue

    for lvlElevation, lvlNumber in zip(lvlElevList, lvlNumList):

        if value > lvlElevation:
            output.append(lvlNumber)
            break

OUT = output
# ----------------------------------------
setParameterByName = Element.SetParameterByName(element=filterByBoolMask_3.out, parameterName=заполняемый_параметр, value=основной_код)
примечание = StringInput("""Данный скрипт заполняет параметр BI_этаж определяя где по высоте находится самая низкая точка объека
Номер этажа скрипт берет из названия уровня
Прнцип наименования уровня должна быть следующим:
12 Этаж, 100 Кровля ...""")  # graph input
