# Dynamo graph SharedParameterDelete.dyn (Dynamo 2.0.4.12684)

# group: Shared parameter Delete
shared_parameters = SharedParameter(index=179)
delete = Orchid.RevitProject.Elements.Element.Delete(element=shared_parameters)
watch = Watch(delete)
